# Grasshopper definition Simulation of collagen in liver lobules.gh (Grasshopper 1.0.7)
# plug-ins: Kangaroo2 Components

# ---- group: The size of the rectangle get simulated
panel = Panel("50")

panel_2 = Panel("25")

# ----
multiplication = Multiplication(A=panel, B="-1")
multiplication_2 = Multiplication(A=panel_2, B="-1")
dom = ConstructDomain(DomainStart=panel, DomainEnd=multiplication)
dom_2 = ConstructDomain(DomainStart=panel_2, DomainEnd=multiplication_2)

# ---- group: The number to control resolution
panel_3 = Panel("3000")

# ----
rectangle = Rectangle(Plane=PlaneXY(0, 0, 0), XSize=dom, YSize=dom_2, Radius=0)  # -> Rectangle, Length
pop2d = Populate2D(Region=rectangle.Rectangle, Count=panel_3, Seed=1)
del = DelaunayMesh(Points=pop2d, Plane=PlaneXY(0, 0, 0))

# ---- group: Portal double rings/ the area to contract
srf = Surface(<surface referenced from the Rhino model>)

# ----
medges = MeshEdges(Mesh=del)  # -> NakedEdges, InteriorEdges, NonManifoldEdges

# ---- group: To fix rim edges
crv = Curve(medges.NakedEdges)
end = EndPoints(Curve=crv)  # -> Start, End
anchor = Anchor(Point=[end.Start, end.End], Strength=10000)

# ----
crv_2 = Curve(graft(medges.InteriorEdges))

# ---- group: KEY points to be controlled
end_2 = EndPoints(Curve=crv_2)  # -> Start, End

# ----
colom = CollisionOneMany(Collider=end_2.End, Obstacles=srf)  # -> Collision, Index
colom_2 = CollisionOneMany(Collider=end_2.Start, Obstacles=srf)  # -> Collision, Index
colom_3 = CollisionOneMany(Collider=end_2.Start, Obstacles=srf)  # -> Collision, Index
colom_4 = CollisionOneMany(Collider=end_2.End, Obstacles=srf)  # -> Collision, Index
not = GateNot(A=colom.Collision)
not_2 = GateNot(A=colom_2.Collision)
or = GateOr(A=not_2, B=not)
cull = CullPattern(List=end_2.Start, CullPattern=colom_3.Collision)
cull_2 = CullPattern(List=end_2.Start, CullPattern=colom_4.Collision)
item = ListItem(List=end_2.Start, Index=cull, Wrap=True)
item_2 = ListItem(List=end_2.End, Index=cull_2, Wrap=True)
and = GateAnd(A=or)
ln = Line(StartPoint=item, EndPoint=item_2)  # -> flatten(Line)
cull_3 = CullPattern(List=end_2.Start, CullPattern=and)
cull_4 = CullPattern(List=end_2.Start, CullPattern=and)
len = Length(Curve=ln)
item_3 = ListItem(List=end_2.Start, Index=cull_3, Wrap=True)
item_4 = ListItem(List=end_2.End, Index=cull_4, Wrap=True)
multiplication_3 = Multiplication(A=len, B=Slider(0.7, range=0..1))
ln_2 = Line(StartPoint=item_3, EndPoint=item_4)  # -> flatten(Line)
length_line = LengthLine(Line=ln, Length=multiplication_3, Strength="160")
len_2 = Length(Curve=ln_2)
multiplication_4 = Multiplication(A=len_2, B=Slider(1, range=0..1))

# ---- group: The switch of simualtion
toggle = BooleanToggle(True)

# ----
length_line_2 = LengthLine(Line=ln_2, Length=multiplication_4, Strength="1")
solver = Solver(GoalObjects=[length_line, length_line_2, anchor], Reset=toggle, Threshold="1e-4", Tolerance=0.01, On=True)  # -> I, V, O
curve = Curve(solver.O)
create_material = CreateMaterial(Diffuse=RGB(255, 105, 180), Specular=RGB(255, 255, 255), Emission=RGB(0, 0, 0), Transparency=0, Shine=0)
custom_preview = CustomPreview(Geometry=curve, Material=create_material)
